# Grasshopper definition loftsurface.gh (Grasshopper 1.0.7)

crv = Curve([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])
c_script = CSharpScript(profileCurves=crv)  # -> out, loftMesh; inputs profileCurves: list of Curve
# ---------- c_script: C# ----------
    Brep brep = Brep.CreateFromLoft(profileCurves, Point3d.Unset, Point3d.Unset, LoftType.Normal, false)[0];
    Rhino.Geometry.Mesh mesh = Rhino.Geometry.Mesh.CreateFromBrep(brep, MeshingParameters.Default)[0];
    loftMesh = mesh;
# ---------- end c_script ----------
